# Dynamo graph BoqExportToXLS.dyn (Dynamo 2.16.1.2727)

string = StringInput("BoqExportToXLS.py")
file_from_path = FileObject(path=string)
readText = FileSystem.ReadText(file=file_from_path)
path = CodeBlock(path=file_from_path) { path; }

# group: Reload
# Reload
reload = BoolSelector(true)

# group: Save To
# Save to
save_to = StringInput("C:\05 TEMP\PrintTest")
code_block = CodeBlock(path=save_to) { path; }

# group: Manual Or Automatic
# Manual - TRUE
manual_naming = BoolSelector(false)

# group: MANUAL_inputs
# BOQ Info
BOQ_Name = StringInput("BER-GF-SE-CP-00-SH-EG-TSLA-8003-01")
rev_number = IntegerSlider(0, range=0..5000 step 1)
rev_seq_n = IntegerSlider(746, range=0..5000 step 1)
elem_filter_name = StringInput("TESLA-RFI-000533")
code_block_2 = CodeBlock(BOQ_Name=BOQ_Name, rev_num=rev_number, rev_seq=rev_seq_n, elem_filter=elem_filter_name)
# ---------- code_block_2.designscript (4 lines) ----------
[BOQ_Name,
rev_num,
rev_seq,
elem_filter];
# ----------------------------------------

# group: AUTOMATICAL_inputs
# Be sure that you have access to database
shop_code = StringInput("BER-GF-SE-CP")
discipline_code = StringInput("ET")
rev_seq_n_2 = IntegerSlider(746, range=0..5000 step 1)
elem_filter_name_2 = StringInput("TESLA-RFI-000533")
code_block_3 = CodeBlock(shop_name=shop_code, disc_code=discipline_code, rev_seq=rev_seq_n_2, elem_filter=elem_filter_name_2)
# ---------- code_block_3.designscript (4 lines) ----------
[shop_name,
disc_code,
rev_seq,
elem_filter];
# ----------------------------------------

if_ = RefactoredIf(test=manual_naming, true=code_block_2, false=code_block_3)
python_script_from_string = PythonStringNode(script=readText, IN[0]=path, IN[1]=reload, IN[2]=code_block, IN[3]=manual_naming, IN[4]=if_)  # CPython3
