# Dynamo graph CalculateEstimatedLoad.dyn (Dynamo 2.13.1.3887)

string = StringInput("CalculateEstimatedLoad.py")
file_from_path = FileObject(path=string)
readText = FileSystem.ReadText(file=file_from_path)
reload = BoolSelector(false)
board_to_modifi = DSModelElementSelection()  # 1 picked in the model; graph input
calculate_all = BoolSelector(false)  # graph input
TEST_board_type = DSModelElementSelection()  # 1 picked in the model
python_script_from_string = PythonStringNode(script=readText, IN[0]=file_from_path, IN[1]=reload, IN[2]=board_to_modifi, IN[3]=calculate_all, IN[4]=TEST_board_type)  # IronPython2
