# Dynamo graph ChangeCircuitMode.dyn (Dynamo 2.3.0.5885)

string = StringInput("ChangeCircuitMode.py")  # graph input
file_from_path = FileObject(path=string)
readText = FileSystem.ReadText(file=file_from_path)
reload = BoolSelector(true)
python_script_from_string = PythonStringNode(script=readText, IN[0]=file_from_path, IN[1]=reload)
