# Dynamo graph ChangeHostBasedFamily.dyn (Dynamo 2.16.2.5624)

string = StringInput("ChangeHostBasedFamily.py")  # graph input
file_from_path = FileObject(path=string)
readText = FileSystem.ReadText(file=file_from_path)
reload = BoolSelector(false)
select_model_elements = DSModelElementsSelection()  # 1 picked in the model

# group: Existing Instances info
changeAllInstancies = BoolSelector(true)

# group: JSON BASE
newFamilyName = StringInput("db_CP_Families.json")

code_block = CodeBlock(IN2=select_model_elements, IN3=changeAllInstancies, IN4=newFamilyName) { IN2; IN3; IN4; }
python_script_from_string = PythonStringNode(script=readText, IN[0]=file_from_path, IN[1]=reload, IN[2]=code_block.IN2, IN[3]=code_block.IN3, IN[4]=code_block.IN4)  # CPython3
code_block_2 = CodeBlock(IN=python_script_from_string) { IN[0]; IN[1]; }
radiansToDegrees = Math.RadiansToDegrees(radians=code_block_2.out1)
code_block_3 = CodeBlock { 1; }
round = Math.Round(number=radiansToDegrees, digits=code_block_3)
setRotation = FamilyInstance.SetRotation(familyInstance=code_block_2.out0, degree=round)
code_block_4 = CodeBlock(IN=round) { IN+180; }
