# Dynamo graph CopyInstanceParameters.dyn (Dynamo 2.16.1.2727)

string = StringInput("CopyInstanceParameters.py")
file_from_path = FileObject(path=string)
readText = FileSystem.ReadText(file=file_from_path)
path = CodeBlock(path=file_from_path) { path; }

# group: Reload
# Reload
reload = BoolSelector(true)

# group: Copy Info
# Where from and where to copy
copy_from = DSModelElementSelection()  # 1 picked in the model
copy_to = DSModelElementsSelection()  # 1 picked in the model

# group: Workset and Phase
# If workset and phase to be copied
copy_workset = BoolSelector(true)
copy_phase_created = BoolSelector(true)
copy_circuit_parameters = BoolSelector(true)
list_create = List.Create(item0=copy_workset, item1=copy_phase_created, item2=copy_circuit_parameters)

# group: Parameters to copy
# Parameter names to be copied
parameters = CodeBlock()
# ---------- parameters.designscript (11 lines) ----------
"BOQ Phase";
"TSLA_Desing_Status_ID";
"TSLA_InstallDate";
"TSLA_Installed";
"TSLA_InstalledBy";
"TSLA_SCOPE_ID";
"Tool Scope ID";
"Tool Prio";
"Cable Tray ID";
"ELMONT_Progress";
"Not in BOQ";
# ----------------------------------------
list_create_2 = List.Create(item0=parameters.out0, item1=parameters.out1, item2=parameters.out2, item3=parameters.out3, item4=parameters.out4, item5=parameters.out5, item6=parameters.out6, item7=parameters.out7, item8=parameters.out8, item9=parameters.out9, item10=parameters.out10)

python_script_from_string = PythonStringNode(script=readText, IN[0]=path, IN[1]=reload, IN[2]=copy_from, IN[4]=list_create, IN[5]=list_create_2)  # CPython3; unwired: IN[3]
