# Dynamo graph CopyParameterToParameter.dyn (Dynamo 2.16.2.5624)

string = StringInput("CopyParameterToParameter.py")
file_from_path = FileObject(path=string)
readText = FileSystem.ReadText(file=file_from_path)
path = CodeBlock(path=file_from_path) { path; }

# group: Reload
# Reload
reload = BoolSelector(false)

# group: FamilyInst
# Where from and where to copy
copy_from = DSModelElementSelection()  # 1 picked in the model; graph input

# group: Params
# Parameter names
paramName_CopyFrom = StringInput("MC Object Variable 1")  # graph input
paramName_CopyTo = StringInput("MC Object Variable 2")  # graph input

python_script_from_string = PythonStringNode(script=readText, IN[0]=path, IN[1]=reload, IN[2]=copy_from, IN[3]=paramName_CopyFrom, IN[4]=paramName_CopyTo)  # CPython3
