# Dynamo graph CopyParametersFromLink.dyn (Dynamo 2.3.0.5885)

boolean = BoolSelector(false)
select_model_element = DSModelElementSelection()  # 1 picked in the model
python_script = Python(IN[0]=boolean, IN[1]=select_model_element)
# ---------- python_script.python (61 lines) ----------
import clr

import sys
# sys.path.append(r"C:\Program Files\Dynamo 0.8")
pyt_path = r'C:\Program Files (x86)\IronPython 2.7\Lib'
sys.path.append(pyt_path)

clr.AddReferenceByName('Microsoft.Office.Interop.Excel, Version=11.0.0.0, Culture=neutral, PublicKeyToken=71e9bce111e9429c')
from Microsoft.Office.Interop import Excel  # type: ignore

import System
from System import Array
from System.Collections.Generic import *

System.Threading.Thread.CurrentThread.CurrentCulture = System.Globalization.CultureInfo("en-US")
from System.Runtime.InteropServices import Marshal

# ================ Revit imports
clr.AddReference('RevitAPI')
import Autodesk
from Autodesk.Revit.DB import *

clr.AddReference('RevitAPIUI')
from Autodesk.Revit.UI import *


clr.AddReference("RevitServices")
import RevitServices
from RevitServices.Persistence import DocumentManager
from RevitServices.Transactions import TransactionManager

# ================ Dynamo imports
clr.AddReference('ProtoGeometry')
import Autodesk.DesignScript

from Autodesk.DesignScript.Geometry import *

clr.AddReference("RevitNodes")
import Revit
clr.ImportExtensions(Revit.Elements)
from Revit.Elements import *
clr.ImportExtensions(Revit.GeometryConversion)
clr.ImportExtensions(Revit.GeometryReferences)


doc = DocumentManager.Instance.CurrentDBDocument
uidoc = DocumentManager.Instance.CurrentUIApplication.ActiveUIDocument
uiapp = DocumentManager.Instance.CurrentUIApplication
app = uiapp.Application
view = doc.ActiveView


obt = Autodesk.Revit.UI.Selection.ObjectType.LinkedElement

refElemLinked = uidoc.Selection.PickObject(obt, "Please pick an element in the linked model")
elem = doc.GetElement(refElemLinked.ElementId)
docLinked = elem.GetLinkDocument()

linkedelement = docLinked.GetElement(refElemLinked.LinkedElementId)

OUT = linkedelement
# ----------------------------------------
