# Dynamo graph CopyTagsToView.dyn (Dynamo 2.16.2.5624)

string = StringInput("CopyTagsToView.py")
file_from_path = FileObject(path=string)
readText = FileSystem.ReadText(file=file_from_path)
path = CodeBlock(path=file_from_path) { path; }

# group: Reload
# Reload
reload = BoolSelector(true)

select_model_element = DSModelElementSelection()  # nothing selected
code_block = CodeBlock { "Overall 1F _Copy_SI"; }
python_script_from_string = PythonStringNode(script=readText, IN[0]=path, IN[1]=reload, IN[2]=select_model_element, IN[3]=code_block)  # CPython3
