# Dynamo graph CreateBoardByPreset.dyn (Dynamo 2.16.1.2727)

string = StringInput("CreateBoardByPreset.py")
file_from_path = FileObject(path=string)
readText = FileSystem.ReadText(file=file_from_path)
reload = BoolSelector(true)

# group: Flexi
presets = CodeBlock { "Main panel_FlexiVillage"; "Maintanace_FlexiVillage"; "Container_FlexiVillage"; }
list_create = List.Create(item0=presets.out0, item1=presets.out1, item2=presets.out2)
integer_slider = IntegerSlider(1, range=0..100 step 1)  # graph input
code_block = CodeBlock(t=integer_slider) { t-1; }
getItemAtIndex = List.GetItemAtIndex(list=list_create, index=code_block)

python_script_from_string = PythonStringNode(script=readText, IN[0]=file_from_path, IN[1]=reload, IN[2]=getItemAtIndex)  # CPython3

# group: Standard
presets_2 = CodeBlock()
# ---------- presets_2.designscript (23 lines) ----------
"3A_sub";
"3B_sub";
"2A";
"2C";
"2E_main";
"2E_sub";
"2E1_main";
"2E1_sub";
"2ET";
"2H";
"2I";
"2J_main";
"2J_sub";
"2R_main";
"2R_sub";
"2R2_main";
"2R2_sub";
"2S_main";
"2S_sub";
"2T_main";
"2T_sub";
"2U_main";
"2U_sub";
# ----------------------------------------
list_create_2 = List.Create(item0=presets_2.out0, item1=presets_2.out1, item2=presets_2.out2, item3=presets_2.out3, item4=presets_2.out4, item5=presets_2.out5, item6=presets_2.out6, item7=presets_2.out7, item8=presets_2.out8, item9=presets_2.out9, item10=presets_2.out10, item11=presets_2.out11, item12=presets_2.out12, item13=presets_2.out13, item14=presets_2.out14, item15=presets_2.out15, item16=presets_2.out16, item17=presets_2.out17, item18=presets_2.out18, item19=presets_2.out19, item20=presets_2.out20, item21=presets_2.out21, item22=presets_2.out22)
integer_slider_2 = IntegerSlider(9, range=0..100 step 1)  # graph input
code_block_2 = CodeBlock(t=integer_slider_2) { t-1; }
getItemAtIndex_2 = List.GetItemAtIndex(list=list_create_2, index=code_block_2)
