# Dynamo graph DALIGetInfo.dyn (Dynamo 2.16.1.2727)

string = StringInput("DALIGetInfo.py")  # graph input
file_from_path = FileObject(path=string)
readText = FileSystem.ReadText(file=file_from_path)
reload = BoolSelector(true)
propose_DALI = BoolSelector(false)  # graph input
select_model_element = DSModelElementSelection()  # 1 picked in the model; graph input
python_script_from_string = PythonStringNode(script=readText, IN[0]=file_from_path, IN[1]=reload, IN[2]=propose_DALI, IN[3]=select_model_element)  # CPython3
