# Dynamo graph EmLight_TreeView.dyn (Dynamo 2.16.2.5624)

string = StringInput("EmLight_TreeView.py")  # graph input
file_from_path = FileObject(path=string)
readText = FileSystem.ReadText(file=file_from_path)
reload = BoolSelector(true)
diagramm_name = StringInput("CP1-KE3W2C05_Emergency lighting")  # graph input
left_panel = DSModelElementSelection()  # 1 picked in the model
python_script_from_string = PythonStringNode(script=readText, IN[0]=file_from_path, IN[1]=reload, IN[2]=diagramm_name, IN[3]=left_panel)  # CPython3
diagramm_name_2 = StringInput("CP1-KE3L2B05_Emergency lighting")  # graph input
right_panel = DSModelElementSelection()  # 1 picked in the model
