# Dynamo graph ExportCircuitInfoByPanelType.dyn (Dynamo 2.13.1.3887)

string = StringInput("ExportCircuitInfoByPanelType.csv")  # graph input
string_2 = StringInput("ExportCircuitInfoByPanelType.py")  # graph input
file_from_path = FileObject(path=string_2)
readText = FileSystem.ReadText(file=file_from_path)
reload = BoolSelector(true)
calc_all = BoolSelector(true)  # graph input
python_script_from_string = PythonStringNode(script=readText, IN[0]=file_from_path, IN[1]=reload, IN[2]=calc_all)  # CPython3
exportCSV = Data.ExportCSV(filePath=string, data=python_script_from_string)
