# Dynamo graph FamilyLocation.dyn (Dynamo 2.16.1.2727)

string = StringInput("FamilyLocation.py")
file_from_path = FileObject(path=string)
readText = FileSystem.ReadText(file=file_from_path)
reload = BoolSelector(true)
code_block = CodeBlock { ["OST_SecurityDevices"]; }
python_script_from_string = PythonStringNode(script=readText, IN[0]=file_from_path, IN[1]=reload, IN[2]=code_block)  # CPython3
code_block_2 = CodeBlock()
# ---------- code_block_2.designscript (11 lines) ----------
["OST_GenericModel",
"OST_FireAlarmDevices",
"OST_DataDevices",
"OST_ElectricalFixtures",
"OST_ElectricalEquipment",
"OST_CommunicationDevices",
"OST_LightingFixtures",
"OST_LightingDevices",
"OST_NurseCallDevices",
"OST_SecurityDevices",
"OST_TelephoneDevices"];
# ----------------------------------------
