# Dynamo graph FindNotConnected.dyn (Dynamo 2.3.0.5885)

file_path = Filename(".\FindNotConnected.csv")
string = StringInput("FindNotConnected.py")  # graph input
file_from_path = FileObject(path=string)
readText = FileSystem.ReadText(file=file_from_path)
reload = BoolSelector(true)
python_script_from_string = PythonStringNode(script=readText, IN[0]=file_from_path, IN[1]=reload)
exportCSV = Data.ExportCSV(filePath=file_path, data=python_script_from_string)
string_2 = StringInput("test,test")  # graph input
