# Dynamo graph GridFindNearest.dyn (Dynamo 2.16.1.2727)

string = StringInput("GridFindNearest.py")  # graph input
file_from_path = FileObject(path=string)
readText = FileSystem.ReadText(file=file_from_path)

# group: Reload
# Reload
reload = BoolSelector(true)

DATA_POC = DSModelElementSelection()  # 1 picked in the model; graph input
python_script_from_string = PythonStringNode(script=readText, IN[0]=file_from_path, IN[1]=reload, IN[2]=DATA_POC)  # CPython3
