# Dynamo graph LineStyleModify.dyn (Dynamo 2.3.2.15696)

string = StringInput("LineStyleModify.py")  # graph input
file_from_path = FileObject(path=string)
readText = FileSystem.ReadText(file=file_from_path)
reload = BoolSelector(false)
styleName = StringInput("E_LEU")
python_script_from_string = PythonStringNode(script=readText, IN[0]=file_from_path, IN[1]=reload, IN[2]=styleName)
