# Dynamo graph PanelSupplyFrom.dyn (Dynamo 2.16.2.5624)

string = StringInput("PanelSupplyFrom.py")  # graph input
file_from_path = FileObject(path=string)
readText = FileSystem.ReadText(file=file_from_path)

# group: Reload
# Reload
reload = BoolSelector(true)

code_block = CodeBlock { "OST_ElectricalEquipment"; }
python_script_from_string = PythonStringNode(script=readText, IN[0]=file_from_path, IN[1]=reload, IN[2]=code_block)  # CPython3
