# Dynamo graph SetLP.dyn (Dynamo 2.16.1.2727)

string = StringInput("SetLP.py")
file_from_path = FileObject(path=string)
readText = FileSystem.ReadText(file=file_from_path)
path = CodeBlock(path=file_from_path) { path; }

# group: Reload
# Reload
reload = BoolSelector(false)

python_script_from_string = PythonStringNode(script=readText, IN[0]=path, IN[1]=reload)  # CPython3
