# Dynamo graph FromPanelToCotntrolCircuit.dyn (Dynamo 2.13.1.3887)

string = StringInput("FromPanelToCotntrolCircuit.py")  # graph input
file_from_path = FileObject(path=string)
readText = FileSystem.ReadText(file=file_from_path)

# group: Reload
# Reload
reload = BoolSelector(true)

python_script_from_string = PythonStringNode(script=readText, IN[0]=file_from_path, IN[1]=reload)  # CPython3
