# Dynamo graph SimarisToRevit.dyn (Dynamo 2.13.1.3887)

string = StringInput("SimarisToRevit.py")  # graph input
file_from_path = FileObject(path=string)
readText = FileSystem.ReadText(file=file_from_path)

# group: Reload
# Reload
reload = BoolSelector(false)

code_block = CodeBlock()
# ---------- code_block.designscript (8 lines) ----------
"CP1-SUBN3WL1.csv";
"CP1-SUBN3WL2.csv";
"CP1-SUBN3WL3.csv";
"CP1-SUBN3WL4.csv";
"CP1-SUBN3WL5.csv";
"CP1-SUBN3WL6.csv";
"CP1-SUBN3WL7.csv";
"CP1-SUBN3WL8.csv";
# ----------------------------------------
python_script_from_string = PythonStringNode(script=readText, IN[0]=file_from_path, IN[1]=reload, IN[2]=code_block.out7)  # CPython3

# group: CSV
# csv database from Simaris
switch_settings = StringInput("CP1-SUBN3WL4.csv")  # graph input
