# Dynamo graph SingleLineDiagramm.dyn (Dynamo 2.13.1.3887)

string = StringInput("SingleLineDiagramm.py")  # graph input
file_from_path = FileObject(path=string)
readText = FileSystem.ReadText(file=file_from_path)

# group: Reload
# Reload
reload = BoolSelector(false)

start_cp_panels_id = CodeBlock()
# ---------- start_cp_panels_id.designscript (16 lines) ----------
494635;
494637;
495458;
495460;
721951;
721953;
723966;
723968;
723991;
723993;
909305;
909307;
1354660;
1354662;
290716;
290718;
# ----------------------------------------
object_on_view = DSModelElementSelection()  # 1 picked in the model; graph input
update_existing_tree_true = BoolSelector(true)
python_script_from_string = PythonStringNode(script=readText, IN[0]=file_from_path, IN[1]=reload, IN[2]=start_cp_panels_id.out15, IN[3]=object_on_view, IN[4]=update_existing_tree_true)  # CPython3
panel = DSModelElementSelection()  # 1 picked in the model; graph input
start_panel_id = Element.Id(element=panel)
