# Dynamo graph TitleBlock_CopyInfo.dyn (Dynamo 2.3.0.5885)

string = StringInput("TitleBlock_CopyInfo.py")  # graph input
file_from_path = FileObject(path=string)
readText = FileSystem.ReadText(file=file_from_path)
reload = BoolSelector(true)
copy_detail_elements = BoolSelector(true)  # graph input
copy_from = DSModelElementSelection()  # 1 picked in the model
copy_to = DSModelElementSelection()  # 1 picked in the model
python_script_from_string = PythonStringNode(script=readText, IN[0]=file_from_path, IN[1]=reload, IN[2]=copy_detail_elements, IN[3]=copy_from, IN[4]=copy_to)
