# Dynamo graph Update_subboard_name.dyn (Dynamo 2.13.1.3887)

string = StringInput("Update_subboard_name.py")  # graph input
file_from_path = FileObject(path=string)
readText = FileSystem.ReadText(file=file_from_path)
reload = BoolSelector(false)
calc_all = BoolSelector(true)  # graph input
test_element = DSModelElementSelection()  # nothing selected; graph input
python_script_from_string = PythonStringNode(script=readText, IN[0]=file_from_path, IN[1]=reload, IN[2]=calc_all, IN[3]=test_element)  # CPython3
