# Dynamo graph VoltageDrop.dyn (Dynamo 2.3.0.5885)

string = StringInput("VoltageDrop.py")  # graph input
file_from_path = FileObject(path=string)
readText = FileSystem.ReadText(file=file_from_path)
reload = BoolSelector(false)
calc_all = BoolSelector(false)  # graph input
select_element = DSModelElementSelection()  # nothing selected; graph input
python_script_from_string = PythonStringNode(script=readText, IN[0]=file_from_path, IN[1]=reload, IN[2]=calc_all, IN[3]=select_element)
